# Grasshopper definition 01.MinimumBoundingRectangle.gh (Grasshopper 1.0.7)

geo = Geometry(<brep referenced from the Rhino model>)

geo_2 = Geometry(<brep referenced from the Rhino model>)
pln = Plane(PlaneXY(0, 0, 0))

crv = Curve(<curve referenced from the Rhino model>)
c_script = CSharpScript(g=geo)  # -> out, Rect; inputs g: GeometryBase
# ---------- c_script: C# ----------
    Plane p = new Plane(0, 0, 1, 0);
    Point3d[] pts = g.GetBoundingBox(p).GetCorners();
    Rect = new Rectangle3d(p, pts[0], pts[2]);
# ---------- end c_script ----------
c_script_2 = CSharpScript(g=geo_2, p=pln)  # -> out, Rect; inputs g: GeometryBase, p: Plane
# ---------- c_script_2: C# ----------
    Point3d[] pts = g.GetBoundingBox(p).GetCorners();
    Rect = new Rectangle3d(p, pts[0], pts[2]);
# ---------- end c_script_2 ----------
c_script_3 = CSharpScript(crv=crv, step=Slider(1, range=0..10), h=Slider(1, range=0..10))  # -> out, skeleton; inputs crv: Curve, step: Double, h: Double
# ---------- c_script_3: C# ----------
    Plane p = new Plane(0, 0, 1, 0);
    ArrayList lst = new ArrayList();
    Vector3d v = new Vector3d(0,0,h);

    Curve[] curCrvs = (crv.Offset(p, step, 0.1, CurveOffsetCornerStyle.Sharp));

    while(crv.GetLength() > 15){
      curCrvs = (crv.Offset(p, step, 0.1, CurveOffsetCornerStyle.Sharp));
      crv = curCrvs[0];
      
      crv.Translate(v);
      for(int j = 0; j < curCrvs.Length; j++){
        lst.Add(curCrvs[j]);
      }
      Print(crv.GetLength().ToString());
    }

    skeleton = lst;
# ---------- end c_script_3 ----------
panel = Panel(c_script_3.out)
