# Grasshopper definition 02.Polar.gh (Grasshopper 1.0.7)
# plug-ins: yung GH

crv = Curve(<curve referenced from the Rhino model>)
number_slider = Slider(88, range=1..360)
pt = Point(<point referenced from the Rhino model>)

crv_2 = Curve(<curve referenced from the Rhino model>)
area = Area(Geometry=crv_2)  # -> Area, Centroid
polarconvexity = PolarConvexity(Point=pt, Curve=crv, Int=number_slider)  # -> Vector, Line, Point
c_script = CSharpScript(crv=crv_2, stp=Slider(100, range=1..100), centerPoint=area.Centroid)  # -> out, A; inputs crv: Curve, stp: Int32, centerPoint: Point3d
# ---------- c_script: C# ----------
    Double[] dbs = crv.DivideByCount(stp, true);
    Point3d[] pts = new Point3d[stp];
    for(int i = 0; i < dbs.Length; i++){
      pts[i] = crv.PointAt(dbs[i]);
    }

    Polyline[] pls = new Polyline[stp];
    int cnt = 0;
    foreach (Point3d pt in pts){
      Polyline pl = new Polyline();
      pl.Add(centerPoint);
      pl.Add(pt);
      
      pls[cnt] = pl;
      cnt++;

    }

    A = pls;
# ---------- end c_script ----------
c_script_2 = CSharpScript(curve=crv, step=number_slider)  # -> out, Vectors, Lines, Points; inputs curve: Curve, step: Int32, centerPoint: Point3d
# ---------- c_script_2: C# ----------
    List<Point3d> points = new List<Point3d>(); //output points
    List<Line> lines = new List<Line>();  //output lines
    List<Vector3d> vectors = new List<Vector3d>();  //output vectors

    // generate each vector
    Point3d startPoint = curve.PointAtStart;
    Vector3d startVector = new Vector3d(startPoint.X - centerPoint.X, startPoint.Y - centerPoint.Y, startPoint.Z - centerPoint.Z);
    Vector3d axis = new Vector3d(0, 0, 1);
    for(int i = 0; i < step; i++){
      vectors.Add(new Vector3d(startVector));
      startVector.Rotate(Math.PI / step, axis);
    }

    // points filter
    foreach(Vector3d vt in vectors){
      Line curLine = new Line(centerPoint, vt, 1);
      List<Point3d> pointList = getPoint(curLine, curve);

      Point3d farPoint = new Point3d(int.MaxValue, int.MaxValue, int.MaxValue);
      Point3d firstPoint = farPoint;  //nearest point in one direction
      Point3d secondPoint = farPoint; //nearest point in the other direction

      foreach(Point3d p in pointList){
        if(p.X - centerPoint.X > 0){
          if(firstPoint.DistanceTo(centerPoint) > p.DistanceTo(centerPoint)) firstPoint = p;
        }
        else{
          if(secondPoint.DistanceTo(centerPoint) > p.DistanceTo(centerPoint))secondPoint = p;
        }
      }
      if(firstPoint.CompareTo(farPoint) != 0) points.Add(firstPoint);
      if(secondPoint.CompareTo(farPoint) != 0) points.Add(secondPoint);
    }

    //generate lines
    foreach(Point3d pt in points){
      lines.Add(new Line(centerPoint, pt));
    }

    Points = points;
    Vectors = vectors;
    Lines = lines;
# ---------- c_script_2: C# additional code ----------
  private List<Point3d> getPoint(Line line, Curve curve){
    List<Point3d> xpoints = new List<Point3d>();
    List<object> xoverlap = new List<object>();

    Rhino.Geometry.Intersect.CurveIntersections xe =
      Rhino.Geometry.Intersect.Intersection.CurveLine(curve, line, 0, 0);

    foreach (Rhino.Geometry.Intersect.IntersectionEvent x in xe)
    {
      if (x.IsPoint)
      {
        xpoints.Add(x.PointA); //intersection points as seen on first curve
        //xpoints.Add(x.PointB); //intersection points on other curves
      }
      else
      { //x is not a point but an overlap
        //xoverlap.Add(new Line(x.PointA, x.PointA2));
        //xoverlap.Add(new Line(x.PointB, x.PointB2));
      }
    }
    return xpoints;
  }


  /// <summary>
  /// This method will be called once every solution, before any calls to RunScript.
  /// </summary>
  public override void BeforeRunScript()
  { }
  /// <summary>
  /// This method will be called once every solution, after any calls to RunScript.
  /// </summary>
  public override void AfterRunScript()
  { }
# ---------- end c_script_2 ----------

pt_2 = Point(c_script_2.Points)
vec = Vector(c_script_2.Vectors)
line = Line(c_script_2.Lines)

panel = Panel(c_script.out)
