# Grasshopper definition 04.Straight Skeleton.gh (Grasshopper 1.0.7)
# plug-ins: yung GH

crv = Curve(<curve referenced from the Rhino model>)
crv_2 = Curve(<curve referenced from the Rhino model>)
erosion = Erosion(Curve=crv_2, Double=Slider(5.2, range=0..10))
erosion_2 = Erosion(Curve=crv, Double=Slider(13.2, range=0..20))
c_script = CSharpScript(crvList=erosion)  # -> out, A, B; inputs crvList: list of Curve
# ---------- c_script: C# ----------
    List<Polyline> pllList = new List<Polyline>();
    foreach(Curve curCrv in crvList){
      Polyline pll;
      curCrv.TryGetPolyline(out pll);
      pllList.Add(pll);
    }

    int size = pllList[0].Count;
    Polyline last = null;

    List<Polyline> frame = new List<Polyline>();
    foreach(Polyline pll in pllList){
      if(pll.Count == size) last = pll;
      frame.Add(pll);
    }

    List<Polyline> output = new List<Polyline>();

    for(int i = 0; i < size; i++){
      Polyline pll = new Polyline();
      pll.Add(pllList[0][i]);
      pll.Add(last[i]);
      output.Add(pll);
    }
    A = output;
    B = frame;
# ---------- end c_script ----------
c_script_2 = CSharpScript(crvList=erosion_2)  # -> out, A, B; inputs crvList: list of Curve
# ---------- c_script_2: C# ----------
    List<Polyline> pllList = new List<Polyline>();
    foreach(Curve curCrv in crvList){
      Polyline pll;
      curCrv.TryGetPolyline(out pll);
      pllList.Add(pll);
    }

    List<Polyline> frame = new List<Polyline>();
    List<LineCurve> output = new List<LineCurve>();


    foreach(Polyline pll in pllList){
      if(frame.Count == 0){
        frame.Add(pll);
        continue;
      }
      Polyline prePll = frame[frame.Count - 1];
      
      /*
      foreach(Point3d pt in pll){
        Point3d closestPt = Rhino.Collections.Point3dList.ClosestPointInList(prePll, pt);
        Polyline newPll = new Polyline();
        newPll.Add(closestPt);
        newPll.Add(pt);
        output.Add(newPll);
      }*/
      //if(prePll.Count > pll.Count + 1) continue;
      foreach(Point3d ppt in prePll){
        Point3d cpt = pll[0];
        foreach(Point3d pt in pll){
          if(ppt.DistanceTo(pt) < ppt.DistanceTo(cpt)) cpt = pt;
        }

        //Line[] lineList = pll.GetSegments();
        LineCurve newLine = new LineCurve(ppt, cpt);
        
        int count = Rhino.Geometry.Intersect.Intersection.CurveCurve(prePll.ToNurbsCurve(), newLine, 0, 0).Count;
        /*foreach(Polyline preAddedPll in frame){
          if(preAddedPll == prePll) continue;
          count += Rhino.Geometry.Intersect.Intersection.CurveCurve(preAddedPll.ToNurbsCurve(), newLine, 0, 0).Count;
        }*/
        
        if(count > 1) continue;
        //if(ppt.DistanceTo(cpt) > 2*step) continue;
        output.Add(newLine);
      }
      frame.Add(pll);

    }

    A = output;
    B = frame;
# ---------- end c_script_2 ----------
panel = Panel(c_script_2.out)
