# Grasshopper definition MedialAxis.gh (Grasshopper 1.0.7)
# plug-ins: Kangaroo2 Components

# Script Overview: General Description:
# Place a Kasita
# 
# Rhino Input:
# 
# IDs
# Parcels (with "PIN" user string)
# Buildings (Parcels (with "PIN" user string)
# 
# Curves:
# Kasita (rectangular footprint)
# Streets (centerlines)
# 
# Output:
# Kasita Placement
# 
# Last Modified Date
# 2021.05.14
# 
# Project:
# General
# 
# Creators:
# Matt Conway
crv_footprint = Curve(graft([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]))
crv_interior = Curve([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])

description = Panel("Smooth Curve")
crv_outlines = Curve(crv_footprint)
cp = ControlPoints(Curve=crv_outlines)  # -> Points, Weights, Knots
lng = ListLength(List=cp.Points)
reb = RebuildCurve(Curve=crv_outlines, Degree=3, Count=lng, Tangents=False)
crv_outlines_2 = Curve(flatten(reb))

# ----
# Description: Create Medial Axis from corridor polygon(s)
crv_outlines_3 = Curve(simplify(crv_interior))
len = Length(Curve=crv_outlines_3)
divide = DivideCurve(Curve=crv_outlines_3, Count=len, Kinks=False)  # -> Points, Tangents, Parameters
cp_2 = ControlPoints(Curve=crv_outlines_3)  # -> Points, Weights, Knots

# ---- group: mesh rooms
bbox = BoundingBox(Content=crv_outlines_3, Plane=PlaneXY(0, 0, 0))  # -> Box, Box_2
boxprop = BoxProperties(Box=bbox.Box)  # -> Center, Diagonal, Area, Volume, Degeneracy
sort = SortList(Keys=boxprop.Area, ValuesA=crv_outlines_3)  # -> Keys, reverse(ValuesA)
split = SplitList(List=sort.ValuesA, Index=1)  # -> ListA, ListB
planar = PlanarSrf(Edges=split.ListA)
srfsplit = SurfaceSplit(Surface=planar, Curves=split.ListB)
area = Area(Geometry=srfsplit)  # -> Area, Centroid
sort_2 = SortList(Keys=area.Area, ValuesA=srfsplit)  # -> Keys, reverse(ValuesA)
item = ListItem(List=sort_2.ValuesA, Index=0, Wrap=True)
mesh = MeshBrep(
    Brep=item,
    Settings={GridMaxCount=0, GridMinCount=16, JaggedSeams=False, MaxEdgeLength=0, MinEdgeLength=0.0001, MinTolerance=0, Refine=True, RefineAngle=0, RelativeTolerance=0.65, SimplePlanes=True, Tolerance=0})  # -> simplify(Mesh)

# ---- group: remove points close to ends
circle = CircleCNR(Center=cp_2.Points, Normal=Vector(0, 0, 1), Radius=1)
incurves = PointInCurves(Point=divide.Points, Curves=circle)  # -> Relationship, Index, Point
equals = Equality(FirstNumber=incurves.Relationship, SecondNumber=0)  # -> Equality, Inequality
cull = CullPattern(List=divide.Points, CullPattern=equals.Equality)

# ---- group: create voronoi points
merge = Merge(Data1=cp_2.Points, Data2=cull)
path_mapper = PathMapper(merge, source="{A;B}", target="{A}")
duppt = RemoveDuplicatePts(Points=path_mapper, Tolerance=0.01)  # -> simplify(UniquePoints)
voronoi = Voronoi(Points=duppt, BruteForceOverride=False)
explode = Explode(Curve=voronoi, Recursive=True)  # -> simplify(Segments), Vertices
path_mapper_2 = PathMapper(explode.Segments, source=["{A;B}", "{A}"], target=["{A}", "{0}"])

# ----
c_script = CSharpScript(M=mesh, L=path_mapper_2, O=crv_outlines_3)  # -> out, C; inputs M: tree of Mesh, L: tree of Line, O: tree of Curve
# ---------- c_script: C# ----------
    //loop through each combination of mesh and curve and output only
    Grasshopper.DataTree<Line> medialaxis = new Grasshopper.DataTree<Line>();
    for (int p = 0; p < M.BranchCount; p++)
    {
      //var path = name.Path(p);
      Mesh mesh = M.Branch(p)[0];
      List<Curve> outlines = O.Branch(p);

      //add furniture to list
      List<Line> medialLines = new List<Line>();
      var lines = L.Branch(p);
      for (int i = 0; i < lines.Count; i++)
      {
        //if either end point is not on mesh
        //we don't add it to the medial lines output
        Line line = lines[i];
        if(!PointOnMesh(mesh, line.PointAt(0))){continue;}
        if(!PointOnMesh(mesh, line.PointAt(1))){continue;}

        Curve lineCurve = line.ToNurbsCurve();
        bool lineTouchesOutline = false;
        for(int j = 0;j < outlines.Count;j++)
        {
          Curve outline = outlines[j];
          //make sure line isn't going back through room outline
          Rhino.Geometry.Intersect.CurveIntersections intersections =
            Rhino.Geometry.Intersect.Intersection.CurveCurve(
            outline,
            lineCurve,
            RhinoDoc.ActiveDoc.ModelAbsoluteTolerance,
            Rhino.RhinoDoc.ActiveDoc.ModelAbsoluteTolerance);
          if(intersections.Count == 0){continue;}
          lineTouchesOutline = true;
          break;
        }
        if(lineTouchesOutline){continue;}

        medialLines.Add(line);
      }

      //create data trees
      GH_Path path = M.Path(p);
      medialaxis.AddRange(medialLines, path);
    }

    C = medialaxis;
# ---------- c_script: C# additional code ----------
  //define up vector
  public Vector3d up = new Vector3d(0, 0, 1);
  public Vector3d down = new Vector3d(0, 0, -1);

  /// <summary>
  /// Test if a Point is on a Mesh (in XY plane)
  /// </summary>
  /// <param name="mesh">Mesh</param>
  /// <param name="pt">Point</param>
  /// <returns>True if Point is on Mesh, False if Point is outside of Mesh</returns>
  public bool PointOnMesh(Mesh mesh, Point3d pt)
  {
    //check if intersections with up vector
    Line lineUp = new Line(pt, up);
    Int32[] intersectionsUp; //where intersection locations are held
    Rhino.Geometry.Intersect.Intersection.MeshLine(mesh, lineUp, out intersectionsUp);

    //check if intersections with down vector
    Line lineDown = new Line(pt, down);
    Int32[] intersectionsDown; //where intersection locations are held
    Rhino.Geometry.Intersect.Intersection.MeshLine(mesh, lineDown, out intersectionsDown);

    if(intersectionsUp == null && intersectionsDown == null){return false;}
    return true;
  }
# ---------- end c_script ----------

crv_medialaxis = Curve(c_script.C)
mesh_room = Mesh(mesh)

# ---- group: join medial axis segments
# Description: Create continuous Medial Axis segments from all Medial Axis lines. Continuous segments end at dead ends and where three Medial Axis segments meet. This gives us lines without branches.
crv_medialaxis_2 = Curve(crv_medialaxis)
dupln = RemoveDuplicateLines(Lines=crv_medialaxis_2, Tolerance=0.01)  # -> simplify(UniqueLines)
c_script_2 = CSharpScript(L=dupln)  # -> out, C; inputs L: tree of Line
# ---------- c_script_2: C# usings ----------
using System.Linq;
# ---------- c_script_2: C# ----------
    //loop through each combination of mesh and curve and output only
    Grasshopper.DataTree<Curve> medialaxis = new Grasshopper.DataTree<Curve>();
    for (int p = 0; p < L.BranchCount; p++)
    {
      //join all medial curves in longer curves
      List<Line> lines = L.Branch(p);
      List<Curve> curves = new List<Curve>();
      for(int i = 0;i < lines.Count;i++)
      {
        curves.Add(lines[i].ToNurbsCurve());
      }
      curves = Curve.JoinCurves(curves).ToList();

      //split curve so there are no loops/self intersections
      for(int i = curves.Count - 1;i >= 0;i--)
      {
        Curve curve = curves[i];
        Rhino.Geometry.Intersect.CurveIntersections intersections = Rhino.Geometry.Intersect.Intersection.CurveSelf(curve, RhinoDoc.ActiveDoc.ModelAbsoluteTolerance);

        if(intersections.Count == 0){continue;}

        curves.RemoveAt(i);
        Curve[] splits = curve.Split(intersections[0].ParameterA);
        curves.AddRange(splits);
      }

      //get all curve endpoints
      List<Point3d> points = new List<Point3d>();
      foreach(Curve curve in curves)
      {
        points.Add(curve.PointAtStart);
        points.Add(curve.PointAtEnd);
      }
      Point3d[] pts = Rhino.Geometry.Point3d.CullDuplicates(points, RhinoDoc.ActiveDoc.ModelAbsoluteTolerance);

      //split curves if they intersect another curve
      double t;
      for(int i = curves.Count - 1;i >= 0;i--)
      {
        Curve curve = curves[i];
        curves.RemoveAt(i); //remove curve, we will replace at the end
        Point3d start = curve.PointAtStart;
        Point3d end = curve.PointAtEnd;

        List<double> parameters = new List<double>(){curve.Domain.Min,curve.Domain.Max};
        for(int j = 0;j < pts.Length;j++)
        {
          Point3d point = pts[j];

          //skip points that are coincident
          if(point.DistanceTo(start) <= RhinoDoc.ActiveDoc.ModelAbsoluteTolerance){continue;}
          if(point.DistanceTo(end) <= RhinoDoc.ActiveDoc.ModelAbsoluteTolerance){continue;}

          //skip points that aren't on the curve
          if(!curve.ClosestPoint(point, out t)){continue;}
          Point3d cp = curve.PointAt(t);
          if(point.DistanceTo(cp) > RhinoDoc.ActiveDoc.ModelAbsoluteTolerance){continue;}
          parameters.Add(t);
        }
        parameters.Sort();


        //split curve at all intersection points
        List<Curve> outputs = new List<Curve>();
        for(int j = 1;j < parameters.Count;j++)
        {
          Curve segment = curve.Trim(parameters[j - 1], parameters[j]);
          outputs.Add(segment);
        }

        curves.AddRange(outputs);
      }

      //create data trees
      GH_Path path = L.Path(p);
      medialaxis.AddRange(curves, path);
    }

    C = medialaxis;
# ---------- end c_script_2 ----------
crv_joinedmedialaxis = Curve(c_script_2.C)

# ---- group: remove medial axis naked branches
# Description: Remove Medial Axis segments that dead end (i.e. branches).
crv_joinedmedialaxis_2 = Curve(crv_joinedmedialaxis)
c_script_3 = CSharpScript(C=crv_joinedmedialaxis_2)  # -> out, S; inputs C: tree of Curve
# ---------- c_script_3: C# ----------
    //Remove curves that only intersect with other curves once (dead end branches)
    //loop through each combination of mesh and curve and output only
    Grasshopper.DataTree<Curve> prunedMedialAxis = new Grasshopper.DataTree<Curve>();
    double t;
    for (int p = 0; p < C.BranchCount; p++)
    {
      //join all medial curves in longer curves
      List<Curve> curves = C.Branch(p);
      List<int> removeIndex = new List<int>();
      for(int i = curves.Count - 1;i >= 0;i--)
      {
        Curve curve = curves[i];
        Point3d start = curve.PointAtStart;
        Point3d end = curve.PointAtEnd;

        //test the start and end point to findout if they are touching other curves
        bool startTouching = false;
        bool endTouching = false;
        for(int j = 0;j < curves.Count;j++)
        {
          //guard statement, if we've already found two touching points, lets get out of this loop and continue;
          if(startTouching && endTouching){break;}
          //skip so we don't compare against itself
          if(j == i){continue;}

          Curve test = curves[j];

          //test start
          test.ClosestPoint(start, out t);
          Point3d cp = test.PointAt(t);
          if(cp.DistanceTo(start) < RhinoDoc.ActiveDoc.ModelAbsoluteTolerance){startTouching = true;}

          //test end
          test.ClosestPoint(end, out t);
          cp = test.PointAt(t);
          if(cp.DistanceTo(end) < RhinoDoc.ActiveDoc.ModelAbsoluteTolerance){endTouching = true;}
        }

        //guard statement if both points are touching other curves
        if(startTouching && endTouching){continue;}
        removeIndex.Add(i);
      }

      //remove those indexes that didn't have both a starting and end point touching another curve
      //we remove after the tests have been completed so that we don't remove test curves too early
      if(curves.Count != removeIndex.Count) //added this conditional because triangles weren't passing through
      {
        for(int i = curves.Count - 1;i >= 0;i--)
        {
          if(!removeIndex.Contains(i)){continue;}
          curves.RemoveAt(i);
        }
      }

      //create data trees
      GH_Path path = C.Path(p);
      prunedMedialAxis.AddRange(curves, path);
    }

    S = prunedMedialAxis;
# ---------- end c_script_3 ----------
crv_branchlessmedialaxis = Curve(c_script_3.S)
