# Grasshopper definition Wave2.gh (Grasshopper 1.0.7)
# plug-ins: yung GH

crv = Curve(graft([<curve referenced from the Rhino model> x28]))
crv_2 = Curve(graft([<curve referenced from the Rhino model> x8]))
crv_3 = Curve([<curve referenced from the Rhino model> x2])
crv_4 = Curve([<curve referenced from the Rhino model> x1276])
crv_5 = Curve(<curve referenced from the Rhino model>)
crv_6 = Curve(<curve referenced from the Rhino model>)
crv_7 = Curve(<curve referenced from the Rhino model>)
crv_8 = Curve(<curve referenced from the Rhino model>)
image_resource = ImageResource()
image = ImageSampler(
    crv_3,
    FilePath="C:\Users\zhang\Desktop\map\WeChat截图_20230308003233.png",
    Filter="Colour",
    Interpolate=False,
    Umax=1,
    Umin=0,
    Vmax=1,
    Vmin=0,
    Wrap=2)
img = ImportImage(File="C:\Users\zhang\Desktop\map\WeChat截图_20230308003259.png", Rectangle=crv_6)
img_2 = ImportImage(File="C:\Users\zhang\Desktop\map\WeChat截图_20230308003233.png", Rectangle=crv_5)
img_3 = ImportImage(File="C:\Users\zhang\Desktop\map\WeChat截图_20230308003249.png", Rectangle=crv_7)
img_4 = ImportImage(File="C:\Users\zhang\Desktop\map\WeChat截图_20230308003308.png", Rectangle=crv_8)
combine = CombineData(Input0=[img_2, img_3, img])  # -> Result, Index
combine_2 = CombineData(Input0=[img_3, img])  # -> Result, Index
combine_3 = CombineData(Input0=[img_4, img_3])  # -> Result, Index
combine_4 = CombineData(Input0=img_4)  # -> Result, Index
entwine = Entwine(
    Branch0X=combine.Result,
    Branch1X=combine_2.Result,
    Branch2X=combine_3.Result,
    Branch3X=combine_4.Result,
    FlattenInputs=False)  # -> simplify(Result)
path_mapper = PathMapper([combine.Result, combine_2.Result], source="{item_count}", target="{path_count}")
combine_5 = CombineData(Input0=[img_2, img, img_3, img_4])  # -> Result, Index
panel = Panel("""0
2""")
panel_2 = Panel("""0
3""")
panel_3 = Panel("""2
0""")
panel_4 = Panel("""2
1""")
panel_5 = Panel("""3
1""")
panel_6 = Panel(entwine)
number_slider = Slider(10, range=0..20)
panel_7 = Panel(panel)
entwine_2 = Entwine(Branch00=panel, Branch01=panel_2, Branch02=panel_3, Branch03=panel_4, Branch04=panel_5, FlattenInputs=True)  # -> simplify(Result)
number_slider_2 = Slider(10, range=0..10)
panel_8 = Panel(combine_5.Result)
c_script = CSharpScript(
    geo=combine_5.Result,
    notConnectRules=entwine_2,
    x=Slider(10, range=0..20),
    y=number_slider,
    dx=Slider(10, range=0..20),
    dy=Slider(10, range=0..20),
    seed=Slider(91, range=0..100),
    times=Slider(100, range=0..100))  # -> out, A, B; inputs geo: list of Mesh, notConnectRules: tree of Int32, x: Int32, y: Int32, dx: Int32, dy: Int32, seed: Int32, times: Int32
# ---------- c_script: C# ----------
    List<Mesh> output = new List<Mesh>(); // output
    List<List<int>> notConnects = new List<List<int>>();
    foreach(List<int> not in notConnectRules.Branches){
      notConnects.Add(not);
    }
    List<HashSet<int>> rules = createRules(geo, notConnects); // create rules
    List<Int32>[,] possibilityMap = buildMap(geo.Count, x, y);  // build map for grids
    //bool[,] visited = new bool[x, y]; // recored visited grids

    Random rd = new Random(seed); //random generator

    for(int i = 0; i < times; i++){
      int index = getMinGrid(rd, x, y, possibilityMap); //select one random gird
      if(index < 0) continue;
      observation(rd, index / y, index % y, x, y, dx, dy, ref possibilityMap, rules, geo, ref output); // observe
    }

    A = output;
    B = createGrids(x, y, dx, dy);
# ---------- c_script: C# additional code ----------
  void observation(Random rd, int x, int y, int mx, int my, int dx, int dy, ref List<Int32>[,] map, List<HashSet<Int32>> rules, List<Mesh> geo, ref List<Mesh> output){ // select a random grid and set it
    if(x < 0 || x >= mx || y < 0 || y >= my) return;
    List<Int32> possibility = map[x, y];  // get possiblility of observed grid
    int type = possibility[rd.Next(0, possibility.Count)];  // get random type

    setGrid(x, y, dx, dy, type, geo, ref output); // set that grid
    possibility.Clear();  // claar possibility
    //map[x, y] = possibility;
    propagation(type, x + 1, y, mx, my, ref map, rules, geo, ref output);
    propagation(type, x - 1, y, mx, my, ref map, rules, geo, ref output);
    propagation(type, x, y + 1, mx, my, ref map, rules, geo, ref output);
    propagation(type, x, y - 1, mx, my, ref map, rules, geo, ref output);
  }

  void propagation(int type, int x, int y, int mx, int my, ref List<Int32>[,] map, List<HashSet<Int32>> rules, List<Mesh> geo, ref List<Mesh> output){
    if(x < 0 || x >= mx || y < 0 || y >= my) return;
    List<Int32> possibility = map[x, y];  // get possibility
    HashSet<Int32> rule = rules[type];  // get rule
    for(int i = possibility.Count - 1; i >= 0; i--){
      if(rule.Contains(possibility[i])){
        possibility.RemoveAt(i);
      }
    }
    //map[x, y] = possibility;
  }

  int getMinGrid(Random rd, int mx, int my, List<Int32>[,] map){
    List<Int32> ret = new List<Int32>();
    int min = 100000;
    int mIndex = -1;
    for(int i = 0; i < mx; i++){
      for(int j = 0; j < my; j++){
        if(map[i, j].Count < min && map[i, j].Count != 0){
          min = map[i, j].Count;
          mIndex = i * my + j;
        }
      }
    }

    for(int i = 0; i < mx; i++){  // get grids with min possibility
      for(int j = 0; j < my; j++){
        if(map[i, j].Count == min){
          ret.Add(i * my + j);
        }
      }
    }
    if(ret.Count == 0) return -1;
    mIndex = ret[rd.Next(0, ret.Count)];

    return mIndex;
  }


  List<Int32>[,] buildMap(int size, int x, int y){ //  build a posibility map for grids
    List<Int32>[,] map = new List<Int32>[x, y];
    for(int i = 0; i < x; i++){
      for(int j = 0; j < y; j++){
        List<Int32> possibility = new List<Int32>();
        for(int k = 0; k < size; k++){  // add all possible choice into the set
          possibility.Add(k);
        }
        map[i, j] = possibility;
      }
    }
    return map;
  }

  List<Rectangle3d> createGrids(int x, int y, int dx, int dy){  // create base grids
    List<Rectangle3d> ret = new List<Rectangle3d>();
    for(int i = 0; i < x; i++){
      for(int j = 0; j < y; j++){
        Rectangle3d rect = new Rectangle3d(new Plane(new Point3d(i * dx, j * dy, 0), new Vector3d(0, 0, 1)), dx, dy);
        ret.Add(rect);
      }
    }
    return ret;
  }

  void setGrid(int x, int y, int dx, int dy, int type, List<Mesh> geo, ref List<Mesh> output){  // add new grid to output
    Mesh ms = new Mesh();
    ms.CopyFrom(geo[type]);
    Vector3d oToP = new Vector3d(geo[type].Vertices[0]); //Point3f
    Vector3d oToN = new Vector3d(x * dx, (y + 1) * dy, 0);
    ms.Translate(-oToP);
    ms.Translate(oToN);
    
    
    //Transform tf = Transform.Scale(new Plane(new Point3d(1, 1, 0), new Vector3d(0, 0, 1)), dx/10, dy/10, 1);
    
    ms.Transform(Transform.Scale(new Plane(new Point3d(1, 1, 0), new Vector3d(0, 0, 1)), dx/10, dy/10, 1));
    output.Add(ms);
  }

  List<HashSet<Int32>> createRules(List<Mesh> geo, List<List<int>> notConnects){ // create rules for selection
    List < HashSet<Int32>> rules = new List<HashSet<Int32>>();
    foreach(List<int> rawRule in notConnects){
      HashSet<Int32> rule = new HashSet<Int32>();
      foreach(int num in rawRule){
        rule.Add(num);
      }
      rules.Add(rule);
    }
    return rules;
  }
# ---------- end c_script ----------
panel_9 = Panel(entwine_2)
wavefunctioncollapse = WaveFunctionCollapse(Mesh=path_mapper, Rules=entwine_2, X=number_slider_2, Y=[number_slider, number_slider_2], Seed=Slider(26, range=0..100))  # -> Meshs, Grids
panel_10 = Panel(c_script.out)
panel_11 = Panel(wavefunctioncollapse.Grids)
