# Grasshopper definition Wave_autosave.gh (Grasshopper 1.0.7)

crv = Curve(graft([<curve referenced from the Rhino model> x28]))
crv_2 = Curve(graft([<curve referenced from the Rhino model> x8]))
crv_3 = Curve([<curve referenced from the Rhino model> x2])
crv_4 = Curve([<curve referenced from the Rhino model> x1276])
crv_5 = Curve(<curve referenced from the Rhino model>)
crv_6 = Curve(<curve referenced from the Rhino model>)
crv_7 = Curve(<curve referenced from the Rhino model>)
crv_8 = Curve(<curve referenced from the Rhino model>)
image_resource = ImageResource()
image = ImageSampler(
    crv_3,
    FilePath="C:\Users\zhang\Desktop\map\WeChat截图_20230308003233.png",
    Filter="Colour",
    Interpolate=False,
    Umax=1,
    Umin=0,
    Vmax=1,
    Vmin=0,
    Wrap=2)
img = ImportImage(File="C:\Users\zhang\Desktop\map\WeChat截图_20230308003233.png", Rectangle=crv_5)
img_2 = ImportImage(File="C:\Users\zhang\Desktop\map\WeChat截图_20230308003259.png", Rectangle=crv_6)
img_3 = ImportImage(File="C:\Users\zhang\Desktop\map\WeChat截图_20230308003249.png", Rectangle=crv_7)
img_4 = ImportImage(File="C:\Users\zhang\Desktop\map\WeChat截图_20230308003308.png", Rectangle=crv_8)
combine = CombineData(Input0=img_4)  # -> Result, Index
combine_2 = CombineData(Input0=[img, img_4])  # -> Result, Index
combine_3 = CombineData(Input0=[img, img_2])  # -> Result, Index
combine_4 = CombineData(Input0=[img_3, img_2, img])  # -> Result, Index
entwine = Entwine(Branch0X=combine.Result, Branch1X=combine_2.Result, Branch2X=combine_3.Result, FlattenInputs=False)  # -> simplify(Result)
entwine_2 = Entwine(Branch0X=entwine, Branch1X=combine_4.Result, FlattenInputs=False)
path_mapper = PathMapper([combine.Result, combine_2.Result], source="{item_count}", target="{path_count}")
combine_5 = CombineData(Input0=[img, img_3, img_2, img_4])  # -> graft(Result), Index
number_slider = Slider(10, range=0..10)
number_slider_2 = Slider(10, range=0..10)
panel = Panel(entwine_2)
c_script = CSharpScript(
    geo=combine_5.Result,
    notConnectRules=entwine_2,
    x=number_slider,
    y=number_slider_2,
    dx=number_slider,
    dy=number_slider_2)  # -> out, A; inputs geo: list of Mesh, notConnectRules: tree of Mesh, x: Int32, y: Int32, dx: Int32, dy: Int32
# ---------- c_script: C# ----------
    List<Mesh> output = new List<Mesh>(); // output
    List<List<Mesh>> notConnects = new List<List<Mesh>>();
    foreach(List<Mesh> not in notConnectRules.Branches){
      notConnects.Add(not);
    }
    List<HashSet<int>> rules = createRules(geo, notConnects);
    List<Int32>[,] possibilityMap = buildMap(geo.Count, x, y);
    int setGrids = 0;
    while(setGrids != x * y){
      observation(x, y, dx, dy, ref setGrids, possibilityMap, geo, ref output);
    }


    A = output;
# ---------- c_script: C# additional code ----------
  List<HashSet<int>> createRules(List<Mesh> geo, List<List<Mesh>> notConnects){ // create rules for selection
    List < HashSet<int>> rules = new List<HashSet<int>>();

    Dictionary<Mesh, int> geoMap = new Dictionary<Mesh, int>();
    for(int i = 0; i < geo.Count; i++){ // create map to get index
      geoMap.Add(geo[i], i);
    }

    for(int i = 0; i < notConnects.Count; i++){  // foreach geo mesh
      List<Mesh> objectOfNotConnect = notConnects[i];
      HashSet<int> indexOfNotConnect = new HashSet<int>();
      for(int j = 0; j < objectOfNotConnect.Count; j++){
        indexOfNotConnect.Add(geoMap[objectOfNotConnect[j]]);   // add index to the list
      }
      rules.Add(indexOfNotConnect);
    }
    return rules;
  }

  List<Int32>[,] buildMap(int size, int x, int y){ //  build a posibility map for grids
    List<Int32>[,] map = new List<Int32>[x, y];
    for(int i = 0; i < x; i++){
      for(int j = 0; j < y; j++){
        List<Int32> possibility = new List<Int32>();
        for(int k = 0; k < size; k++){  // add all possible choice into the set
          possibility.Add(k);
        }
        map[i, j] = possibility;
      }
    }
    return map;
  }

  List<Rectangle3d> createGrids(int x, int y, int dx, int dy){  // create base grids
    List<Rectangle3d> ret = new List<Rectangle3d>();
    for(int i = 0; i < x; i++){
      for(int j = 0; j < y; j++){
        Rectangle3d rect = new Rectangle3d(new Plane(new Point3d(i * dx, j * dy, 0), new Vector3d(0, 0, 1)), dx, dy);
        ret.Add(rect);
      }
    }
    return ret;
  }

  void observation(int x, int y, int dx, int dy, ref int setGrids, List<Int32>[,] map, List<Mesh> geo, ref List<Mesh> output){ // select a random grid and set it
    Random rd = new Random();
    int rx = rd.Next(0, x);
    int ry = rd.Next(0, y);

    while(setGrids != x * y || map[rx, ry].Count == 0){ // skip grids that already set
      rx = rd.Next(0, x);
      ry = rd.Next(0, y);
    }
    setGrid(rx, ry, dx, dy, chooseGrid(rx, ry, map), geo, ref output);
    setGrids++;
  }

  int chooseGrid(int x, int y, List<Int32>[,] map){  // choose one possible random grid
    Random rd = new Random();
    int rdm = rd.Next(0, map[x, y].Count);
    return rdm;    // select one random grid from possible geos
  }


  void setGrid(int x, int y, int dx, int dy, int type, List<Mesh> geo, ref List<Mesh> output){  // add new grid to output
    Mesh ms = new Mesh();
    ms.CopyFrom(geo[type]);
    Vector3d oToP = new Vector3d(geo[type].Vertices[0]); //Point3f
    Vector3d oToN = new Vector3d(x * dx, y * dy, 0);
    ms.Translate(-oToP);
    ms.Translate(oToN);
    output.Add(ms);
  }

  void propagation(int originalType, int x, int y, int dx, int dy, List<int>[,] possibilityMap, List<HashSet<int>> rules, List<Mesh> geo, List<Mesh> output){
    if(x < 0 || x >= dx || y < 0 || y >= dy) return;
    List<int> possibility = possibilityMap[x, y];
    if(possibility.Count == 0) return;    // skip if already set
    HashSet<int> rule = rules[originalType];

    int i = 0;
    while(i != possibility.Count){  // remove all impossible grids
      if(rule.Contains(possibility[i])){
        possibility.RemoveAt(i);
      }
      else{
        i++;
      }
    }

    if(possibility.Count == 1){ // if only one possibility left
      int type = possibility[0];
      setGrid(x, y, dx, dy, type, geo, ref output);
      possibility.RemoveAt(0);

      propagation(type, x + 1, y, dx, dy, possibilityMap, rules, geo, output);
      propagation(type, x - 1, y, dx, dy, possibilityMap, rules, geo, output);
      propagation(type, x, y + 1, dx, dy, possibilityMap, rules, geo, output);
      propagation(type, x, y - 1, dx, dy, possibilityMap, rules, geo, output);
    }

    if(possibility.Count == 0) return;
  }
# ---------- end c_script ----------
panel_2 = Panel(c_script.out)
c_script_2 = CSharpScript(
    geo=combine_5.Result,
    notConnectRules=entwine_2,
    x=number_slider,
    y=number_slider_2,
    dx=number_slider,
    dy=number_slider_2)  # -> out, A; inputs geo: list of Mesh, notConnectRules: tree of Mesh, x: Int32, y: Int32, dx: Int32, dy: Int32
# ---------- c_script_2: C# ----------
    List<Mesh> output = new List<Mesh>(); // output
    List<List<Mesh>> notConnects = new List<List<Mesh>>();
    foreach(List<Mesh> not in notConnectRules.Branches){
      notConnects.Add(not);
    }
    List<HashSet<int>> rules = createRules(geo, notConnects);
    List<Int32>[,] possibilityMap = buildMap(geo.Count, x, y);
    int setGrids = 0;
    while(setGrids != x * y){
      observation(x, y, dx, dy, ref setGrids, possibilityMap, geo, ref output);
    }


    A = output;
# ---------- c_script_2: C# additional code ----------
  List<HashSet<int>> createRules(List<Mesh> geo, List<List<Mesh>> notConnects){ // create rules for selection
    List < HashSet<int>> rules = new List<HashSet<int>>();

    Dictionary<Mesh, int> geoMap = new Dictionary<Mesh, int>();
    for(int i = 0; i < geo.Count; i++){ // create map to get index
      geoMap.Add(geo[i], i);
    }

    for(int i = 0; i < notConnects.Count; i++){  // foreach geo mesh
      List<Mesh> objectOfNotConnect = notConnects[i];
      HashSet<int> indexOfNotConnect = new HashSet<int>();
      for(int j = 0; j < objectOfNotConnect.Count; j++){
        indexOfNotConnect.Add(0);   // add index to the list
      }
      rules.Add(indexOfNotConnect);
    }
    return rules;
  }

  List<Int32>[,] buildMap(int size, int x, int y){ //  build a posibility map for grids
    List<Int32>[,] map = new List<Int32>[x, y];
    for(int i = 0; i < x; i++){
      for(int j = 0; j < y; j++){
        List<Int32> possibility = new List<Int32>();
        for(int k = 0; k < size; k++){  // add all possible choice into the set
          possibility.Add(k);
        }
        map[i, j] = possibility;
      }
    }
    return map;
  }

  List<Rectangle3d> createGrids(int x, int y, int dx, int dy){  // create base grids
    List<Rectangle3d> ret = new List<Rectangle3d>();
    for(int i = 0; i < x; i++){
      for(int j = 0; j < y; j++){
        Rectangle3d rect = new Rectangle3d(new Plane(new Point3d(i * dx, j * dy, 0), new Vector3d(0, 0, 1)), dx, dy);
        ret.Add(rect);
      }
    }
    return ret;
  }

  void observation(int x, int y, int dx, int dy, ref int setGrids, List<Int32>[,] map, List<Mesh> geo, ref List<Mesh> output){ // select a random grid and set it
    Random rd = new Random();
    int rx = rd.Next(0, x);
    int ry = rd.Next(0, y);

    while(setGrids != x * y || map[rx, ry].Count == 0){ // skip grids that already set
      rx = rd.Next(0, x);
      ry = rd.Next(0, y);
    }
    setGrid(rx, ry, dx, dy, chooseGrid(rx, ry, map), geo, ref output);
    setGrids++;
  }

  int chooseGrid(int x, int y, List<Int32>[,] map){  // choose one possible random grid
    Random rd = new Random();
    int rdm = rd.Next(0, map[x, y].Count);
    return rdm;    // select one random grid from possible geos
  }


  void setGrid(int x, int y, int dx, int dy, int type, List<Mesh> geo, ref List<Mesh> output){  // add new grid to output
    Mesh ms = new Mesh();
    ms.CopyFrom(geo[type]);
    Vector3d oToP = new Vector3d(geo[type].Vertices[0]); //Point3f
    Vector3d oToN = new Vector3d(x * dx, y * dy, 0);
    ms.Translate(-oToP);
    ms.Translate(oToN);
    output.Add(ms);
  }

  void propagation(int originalType, int x, int y, int dx, int dy, List<int>[,] possibilityMap, List<HashSet<int>> rules, List<Mesh> geo, List<Mesh> output){
    if(x < 0 || x >= dx || y < 0 || y >= dy) return;
    List<int> possibility = possibilityMap[x, y];
    if(possibility.Count == 0) return;    // skip if already set
    HashSet<int> rule = rules[originalType];

    int i = 0;
    while(i != possibility.Count){  // remove all impossible grids
      if(rule.Contains(possibility[i])){
        possibility.RemoveAt(i);
      }
      else{
        i++;
      }
    }

    if(possibility.Count == 1){ // if only one possibility left
      int type = possibility[0];
      setGrid(x, y, dx, dy, type, geo, ref output);
      possibility.RemoveAt(0);

      propagation(type, x + 1, y, dx, dy, possibilityMap, rules, geo, output);
      propagation(type, x - 1, y, dx, dy, possibilityMap, rules, geo, output);
      propagation(type, x, y + 1, dx, dy, possibilityMap, rules, geo, output);
      propagation(type, x, y - 1, dx, dy, possibilityMap, rules, geo, output);
    }

    if(possibility.Count == 0) return;
  }
# ---------- end c_script_2 ----------
