# Grasshopper definition demo.gh (Grasshopper 1.0.7)
# plug-ins: yung GH

number_slider = Slider(2, range=0.4..2)
crv = Curve([<curve referenced from the Rhino model> x9])
crv_2 = Curve(<curve referenced from the Rhino model>)
crv_3 = Curve([<curve referenced from the Rhino model> x9])
crv_4 = Curve(<curve referenced from the Rhino model>)
erosion = Erosion(Curve=crv, Double=number_slider)
straight_skeleton = StraightSkeleton(Curve=crv_3, Double=number_slider)  # -> Skeleton, Frame
divdist = DivideDistance(Curve=crv_4, Distance=Slider(63, range=0.1..63))  # -> Points, Tangents, Parameters
rec = Rectangle({Plane=PlaneXY(93.28943257, 93.28943257, 0), Size=Domain2(u=-93.28943257..93.28943257, v=-93.28943257..93.28943257)})
pop2d = Populate2D(Region=rec, Count=Slider(1000, range=0..1000), Seed=1)
item = ListItem(List=divdist.Points, Index=Slider(1, range=0..100), Wrap=True)
quadrilateralgrids = QuadrilateralGrids(Points=pop2d)
pt = Point(item)
polarconvexity = PolarConvexity(Point=pt, Curve=crv_2, Int=Slider(48, range=0..200))  # -> Vector, Line, Point
crv_5 = Curve(polarconvexity.Line)
crv_6 = Curve(quadrilateralgrids)
