# Grasshopper definition idt.gh (Grasshopper 1.0.7)
# plug-ins: Marching Cubes

number_slider = Slider(10, range=0..10)
number_slider_2 = Slider(227, range=0..1000)
number_slider_3 = Slider(10, range=0..10)
brep = Brep(<brep referenced from the Rhino model>)
box = Box({Plane=Plane(origin=(0, 23.46760353, 23.46760353), x=(1, 0, 0), y=(0, -1, 0)), X=Domain(0, 23.46760353), Y=Domain(0, 23.46760353), Z=Domain(0, 23.46760353)})
pop3d = Populate3D(Region=box, Count=100, Seed=1)
c_script = CSharpScript(pointsC=pop3d, cubeDim=number_slider_3, cubeNum=number_slider, isoLevel=number_slider_2)  # -> out, A; inputs pointsC: list of Point3d, cubeDim: Int32, cubeNum: Int32, isoLevel: Double
# ---------- c_script: C# ----------
    List<Vector3d> vs = new List<Vector3d>();
    int cubeDimInt = cubeDim / 1;
    vs.Add(new Vector3d(0, 0, 0));
    vs.Add(new Vector3d(0, cubeDimInt, 0));
    vs.Add(new Vector3d(cubeDimInt, cubeDimInt, 0));
    vs.Add(new Vector3d(cubeDimInt, 0, 0));
    vs.Add(new Vector3d(0, 0, cubeDimInt));
    vs.Add(new Vector3d(0, cubeDimInt, cubeDimInt));
    vs.Add(new Vector3d(cubeDimInt, cubeDimInt, cubeDimInt));
    vs.Add(new Vector3d(cubeDimInt, 0, cubeDimInt));

    List<List<Point3d>> cubePoints = new List<List<Point3d>>();
    Vector3d xDir = new Vector3d(0, 0, 0);
    Vector3d yDir = new Vector3d(0, 0, 0);
    Vector3d zDir = new Vector3d(0, 0, 0);

    for(int r = cubeDim; r < cubeNum * cubeDimInt; r += cubeDim){
      List<Point3d> oneCubePts = new List<Point3d>();
      foreach (Vector3d v in vs){
        xDir = v + new Vector3d(r, 0, 0);
        yDir = xDir + v + new Vector3d(0, r, 0);
        zDir = xDir + v + new Vector3d(0, 0, r) + yDir + new Vector3d(0, 0, r);
        Point3d point = new Point3d(xDir + yDir + zDir);
        oneCubePts.Add(point);
      }
      cubePoints.Add(oneCubePts);
    }
    PointCloud pointCloud = new PointCloud(pointsC);
    //寻找点云中的最近点
    List<List<Brep>> output = new List<List<Brep>>();
    

      List<Point3d> coners = new List<Point3d>();
      List<double> dists = new List<double>();
      foreach(Point3d curPoint in cubePoints[0]){
        Point3d cloestPt = pointCloud.GetPoints()[pointCloud.ClosestPoint(curPoint)];
        double dist = cloestPt.DistanceTo(curPoint);
        coners.Add(cloestPt);
        dists.Add(dist);
        output.Add(polygon(dists, coners, isoLevel));
      }
    
    
    A = output;
# ---------- c_script: C# additional code ----------
  List<Brep> polygon(List<double> cornerValues, List<Point3d> cornerPos, double isoLevel){

    int[] edgeTable = { 0x0  , 0x109, 0x203, 0x30a, 0x406, 0x50f, 0x605, 0x70c,
      0x80c, 0x905, 0xa0f, 0xb06, 0xc0a, 0xd03, 0xe09, 0xf00,
      0x190, 0x99 , 0x393, 0x29a, 0x596, 0x49f, 0x795, 0x69c,
      0x99c, 0x895, 0xb9f, 0xa96, 0xd9a, 0xc93, 0xf99, 0xe90,
      0x230, 0x339, 0x33 , 0x13a, 0x636, 0x73f, 0x435, 0x53c,
      0xa3c, 0xb35, 0x83f, 0x936, 0xe3a, 0xf33, 0xc39, 0xd30,
      0x3a0, 0x2a9, 0x1a3, 0xaa , 0x7a6, 0x6af, 0x5a5, 0x4ac,
      0xbac, 0xaa5, 0x9af, 0x8a6, 0xfaa, 0xea3, 0xda9, 0xca0,
      0x460, 0x569, 0x663, 0x76a, 0x66 , 0x16f, 0x265, 0x36c,
      0xc6c, 0xd65, 0xe6f, 0xf66, 0x86a, 0x963, 0xa69, 0xb60,
      0x5f0, 0x4f9, 0x7f3, 0x6fa, 0x1f6, 0xff , 0x3f5, 0x2fc,
      0xdfc, 0xcf5, 0xfff, 0xef6, 0x9fa, 0x8f3, 0xbf9, 0xaf0,
      0x650, 0x759, 0x453, 0x55a, 0x256, 0x35f, 0x55 , 0x15c,
      0xe5c, 0xf55, 0xc5f, 0xd56, 0xa5a, 0xb53, 0x859, 0x950,
      0x7c0, 0x6c9, 0x5c3, 0x4ca, 0x3c6, 0x2cf, 0x1c5, 0xcc ,
      0xfcc, 0xec5, 0xdcf, 0xcc6, 0xbca, 0xac3, 0x9c9, 0x8c0,
      0x8c0, 0x9c9, 0xac3, 0xbca, 0xcc6, 0xdcf, 0xec5, 0xfcc,
      0xcc , 0x1c5, 0x2cf, 0x3c6, 0x4ca, 0x5c3, 0x6c9, 0x7c0,
      0x950, 0x859, 0xb53, 0xa5a, 0xd56, 0xc5f, 0xf55, 0xe5c,
      0x15c, 0x55 , 0x35f, 0x256, 0x55a, 0x453, 0x759, 0x650,
      0xaf0, 0xbf9, 0x8f3, 0x9fa, 0xef6, 0xfff, 0xcf5, 0xdfc,
      0x2fc, 0x3f5, 0xff , 0x1f6, 0x6fa, 0x7f3, 0x4f9, 0x5f0,
      0xb60, 0xa69, 0x963, 0x86a, 0xf66, 0xe6f, 0xd65, 0xc6c,
      0x36c, 0x265, 0x16f, 0x66 , 0x76a, 0x663, 0x569, 0x460,
      0xca0, 0xda9, 0xea3, 0xfaa, 0x8a6, 0x9af, 0xaa5, 0xbac,
      0x4ac, 0x5a5, 0x6af, 0x7a6, 0xaa , 0x1a3, 0x2a9, 0x3a0,
      0xd30, 0xc39, 0xf33, 0xe3a, 0x936, 0x83f, 0xb35, 0xa3c,
      0x53c, 0x435, 0x73f, 0x636, 0x13a, 0x33 , 0x339, 0x230,
      0xe90, 0xf99, 0xc93, 0xd9a, 0xa96, 0xb9f, 0x895, 0x99c,
      0x69c, 0x795, 0x49f, 0x596, 0x29a, 0x393, 0x99 , 0x190,
      0xf00, 0xe09, 0xd03, 0xc0a, 0xb06, 0xa0f, 0x905, 0x80c,
      0x70c, 0x605, 0x50f, 0x406, 0x30a, 0x203, 0x109, 0x0 };

    int[,] triTable = {
      {-1, -1, -1, -1, -1, -1, -1, -1, -1, -1, -1, -1, -1, -1, -1, -1},
      {0, 8, 3, -1, -1, -1, -1, -1, -1, -1, -1, -1, -1, -1, -1, -1},
      {0, 1, 9, -1, -1, -1, -1, -1, -1, -1, -1, -1, -1, -1, -1, -1},
      {1, 8, 3, 9, 8, 1, -1, -1, -1, -1, -1, -1, -1, -1, -1, -1},
      {1, 2, 10, -1, -1, -1, -1, -1, -1, -1, -1, -1, -1, -1, -1, -1},
      {0, 8, 3, 1, 2, 10, -1, -1, -1, -1, -1, -1, -1, -1, -1, -1},
      {9, 2, 10, 0, 2, 9, -1, -1, -1, -1, -1, -1, -1, -1, -1, -1},
      {2, 8, 3, 2, 10, 8, 10, 9, 8, -1, -1, -1, -1, -1, -1, -1},
      {3, 11, 2, -1, -1, -1, -1, -1, -1, -1, -1, -1, -1, -1, -1, -1},
      {0, 11, 2, 8, 11, 0, -1, -1, -1, -1, -1, -1, -1, -1, -1, -1},
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      };

    int cubeIndex = 1;  // 选择cube
    /*
    if(cornerValues[0] < isoLevel) cubeIndex = cubeIndex | 1;
    if(cornerValues[1] < isoLevel) cubeIndex = cubeIndex | 2;
    if(cornerValues[2] < isoLevel) cubeIndex = cubeIndex | 4;
    if(cornerValues[3] < isoLevel) cubeIndex = cubeIndex | 8;
    if(cornerValues[4] < isoLevel) cubeIndex = cubeIndex | 16;
    if(cornerValues[5] < isoLevel) cubeIndex = cubeIndex | 32;
    if(cornerValues[6] < isoLevel) cubeIndex = cubeIndex | 64;
    if(cornerValues[7] < isoLevel) cubeIndex = cubeIndex | 128;
  */

    if(edgeTable[cubeIndex] == 0) return null;


    Point3d[] vertList = new Point3d[12];

    if(Convert.ToBoolean(edgeTable[cubeIndex] & 1))        vertList[0] = vertexInterp(isoLevel, cornerPos[0], cornerPos[1], cornerValues[0], cornerValues[1]);
    if(Convert.ToBoolean(edgeTable[cubeIndex] & 2))        vertList[1] = vertexInterp(isoLevel, cornerPos[1], cornerPos[2], cornerValues[1], cornerValues[2]);
    if(Convert.ToBoolean(edgeTable[cubeIndex] & 4))        vertList[2] = vertexInterp(isoLevel, cornerPos[2], cornerPos[3], cornerValues[2], cornerValues[3]);
    if(Convert.ToBoolean(edgeTable[cubeIndex] & 8))        vertList[3] = vertexInterp(isoLevel, cornerPos[3], cornerPos[0], cornerValues[3], cornerValues[0]);
    if(Convert.ToBoolean(edgeTable[cubeIndex] & 16))       vertList[4] = vertexInterp(isoLevel, cornerPos[4], cornerPos[5], cornerValues[4], cornerValues[5]);
    if(Convert.ToBoolean(edgeTable[cubeIndex] & 32))       vertList[5] = vertexInterp(isoLevel, cornerPos[5], cornerPos[6], cornerValues[5], cornerValues[6]);
    if(Convert.ToBoolean(edgeTable[cubeIndex] & 64))       vertList[6] = vertexInterp(isoLevel, cornerPos[6], cornerPos[7], cornerValues[6], cornerValues[7]);
    if(Convert.ToBoolean(edgeTable[cubeIndex] & 128))      vertList[7] = vertexInterp(isoLevel, cornerPos[7], cornerPos[4], cornerValues[7], cornerValues[4]);
    if(Convert.ToBoolean(edgeTable[cubeIndex] & 256))      vertList[8] = vertexInterp(isoLevel, cornerPos[0], cornerPos[4], cornerValues[0], cornerValues[4]);
    if(Convert.ToBoolean(edgeTable[cubeIndex] & 512))      vertList[9] = vertexInterp(isoLevel, cornerPos[1], cornerPos[5], cornerValues[1], cornerValues[5]);
    if(Convert.ToBoolean(edgeTable[cubeIndex] & 1024))     vertList[10] = vertexInterp(isoLevel, cornerPos[2], cornerPos[6], cornerValues[2], cornerValues[6]);
    if(Convert.ToBoolean(edgeTable[cubeIndex] & 2048))     vertList[11] = vertexInterp(isoLevel, cornerPos[3], cornerPos[7], cornerValues[3], cornerValues[7]);

    List<Brep> triangles = new List<Brep>();
    int k = 0;
    while(triTable[cubeIndex, k] != -1){
      Brep triangle = new Brep();
      Point3d a = vertList[triTable[cubeIndex, k]];
      Point3d b = vertList[triTable[cubeIndex, k + 1]];
      Point3d c = vertList[triTable[cubeIndex, k + 2]];
      triangle.AddEdgeCurve(new LineCurve(a, b));
      triangle.AddEdgeCurve(new LineCurve(b, c));
      triangle.AddEdgeCurve(new LineCurve(a, c));
      triangles.Add(triangle);
      k += 3;
    }
    return triangles;
  }


  Point3d vertexInterp(double isoLevel, Point3d p1, Point3d p2, double valP1, double valP2){
    if(Math.Abs(isoLevel - valP1) < 0.00001) return p1;
    if(Math.Abs(isoLevel - valP2) < 0.00001) return p2;
    if(Math.Abs(valP1 - valP2) < 0.00001) return p1;
    double mu = (isoLevel - valP1) / (valP2 - valP1);
    Point3d p = new Point3d(
      p1[0] + mu * (p2[0] - p1[0]),
      p1[1] + mu * (p2[1] - p1[1]),
      p1[2] + mu * (p2[2] - p1[2])
      );
    return p;
  }
# ---------- end c_script ----------
marchingcubes = MarchingCubes(Point_cloud=pop3d, Cube_dim=number_slider_3, Cube_num=number_slider, Isolevel=number_slider_2)  # disabled
panel = Panel(pop3d)
c_script_2 = CSharpScript(pointsC=pop3d, cubeDim=number_slider_3, cubeNum=number_slider, isoLevel=number_slider_2)  # -> out, A; inputs pointsC: list of Point3d, cubeDim: Int32, cubeNum: Int32, isoLevel: Double
# ---------- c_script_2: C# ----------
    List<Mesh> output = new List<Mesh>();
    List<Vector3d> vs = getVectorsOfCube(cubeDim);  // get vectors of cubes
    List<List<Point3d>> allCubePoints = new List<List<Point3d>>();
    for (int r = cubeDim; r < cubeNum * cubeDim; r += cubeDim)
    {
      List<Point3d> oneCubePts = getPointsOfOneCube(vs, r);
      allCubePoints.Add(oneCubePts);
    }

    PointCloud pointCloud = new PointCloud(pointsC);
    foreach (List<Point3d> oneCubePts in allCubePoints)
    {
      List<Point3d> coners = new List<Point3d>();
      List<double> dists = new List<double>();
      foreach (Point3d curPoint in oneCubePts)
      {
        Point3d cloestPt = pointCloud.GetPoints()[pointCloud.ClosestPoint(curPoint)];
        double dist = cloestPt.DistanceTo(curPoint);
        coners.Add(cloestPt);
        dists.Add(dist);
      }
      List<Mesh> ms = Polygon(dists, coners, isoLevel);
      if(ms == null) continue;
      for(int i = 0; i < ms.Count; i++){
        output.Add(ms[i]);
      }
    }

    A = output;
# ---------- c_script_2: C# additional code ----------
  private List<Mesh> Polygon(List<double> cornerValues, List<Point3d> cornerPos, double isoLevel)
  {

    int[] edgeTable = { 0x0  , 0x109, 0x203, 0x30a, 0x406, 0x50f, 0x605, 0x70c,
      0x80c, 0x905, 0xa0f, 0xb06, 0xc0a, 0xd03, 0xe09, 0xf00,
      0x190, 0x99 , 0x393, 0x29a, 0x596, 0x49f, 0x795, 0x69c,
      0x99c, 0x895, 0xb9f, 0xa96, 0xd9a, 0xc93, 0xf99, 0xe90,
      0x230, 0x339, 0x33 , 0x13a, 0x636, 0x73f, 0x435, 0x53c,
      0xa3c, 0xb35, 0x83f, 0x936, 0xe3a, 0xf33, 0xc39, 0xd30,
      0x3a0, 0x2a9, 0x1a3, 0xaa , 0x7a6, 0x6af, 0x5a5, 0x4ac,
      0xbac, 0xaa5, 0x9af, 0x8a6, 0xfaa, 0xea3, 0xda9, 0xca0,
      0x460, 0x569, 0x663, 0x76a, 0x66 , 0x16f, 0x265, 0x36c,
      0xc6c, 0xd65, 0xe6f, 0xf66, 0x86a, 0x963, 0xa69, 0xb60,
      0x5f0, 0x4f9, 0x7f3, 0x6fa, 0x1f6, 0xff , 0x3f5, 0x2fc,
      0xdfc, 0xcf5, 0xfff, 0xef6, 0x9fa, 0x8f3, 0xbf9, 0xaf0,
      0x650, 0x759, 0x453, 0x55a, 0x256, 0x35f, 0x55 , 0x15c,
      0xe5c, 0xf55, 0xc5f, 0xd56, 0xa5a, 0xb53, 0x859, 0x950,
      0x7c0, 0x6c9, 0x5c3, 0x4ca, 0x3c6, 0x2cf, 0x1c5, 0xcc ,
      0xfcc, 0xec5, 0xdcf, 0xcc6, 0xbca, 0xac3, 0x9c9, 0x8c0,
      0x8c0, 0x9c9, 0xac3, 0xbca, 0xcc6, 0xdcf, 0xec5, 0xfcc,
      0xcc , 0x1c5, 0x2cf, 0x3c6, 0x4ca, 0x5c3, 0x6c9, 0x7c0,
      0x950, 0x859, 0xb53, 0xa5a, 0xd56, 0xc5f, 0xf55, 0xe5c,
      0x15c, 0x55 , 0x35f, 0x256, 0x55a, 0x453, 0x759, 0x650,
      0xaf0, 0xbf9, 0x8f3, 0x9fa, 0xef6, 0xfff, 0xcf5, 0xdfc,
      0x2fc, 0x3f5, 0xff , 0x1f6, 0x6fa, 0x7f3, 0x4f9, 0x5f0,
      0xb60, 0xa69, 0x963, 0x86a, 0xf66, 0xe6f, 0xd65, 0xc6c,
      0x36c, 0x265, 0x16f, 0x66 , 0x76a, 0x663, 0x569, 0x460,
      0xca0, 0xda9, 0xea3, 0xfaa, 0x8a6, 0x9af, 0xaa5, 0xbac,
      0x4ac, 0x5a5, 0x6af, 0x7a6, 0xaa , 0x1a3, 0x2a9, 0x3a0,
      0xd30, 0xc39, 0xf33, 0xe3a, 0x936, 0x83f, 0xb35, 0xa3c,
      0x53c, 0x435, 0x73f, 0x636, 0x13a, 0x33 , 0x339, 0x230,
      0xe90, 0xf99, 0xc93, 0xd9a, 0xa96, 0xb9f, 0x895, 0x99c,
      0x69c, 0x795, 0x49f, 0x596, 0x29a, 0x393, 0x99 , 0x190,
      0xf00, 0xe09, 0xd03, 0xc0a, 0xb06, 0xa0f, 0x905, 0x80c,
      0x70c, 0x605, 0x50f, 0x406, 0x30a, 0x203, 0x109, 0x0 };

    int[,] triTable = {
      {-1, -1, -1, -1, -1, -1, -1, -1, -1, -1, -1, -1, -1, -1, -1, -1},
      {0, 8, 3, -1, -1, -1, -1, -1, -1, -1, -1, -1, -1, -1, -1, -1},
      {0, 1, 9, -1, -1, -1, -1, -1, -1, -1, -1, -1, -1, -1, -1, -1},
      {1, 8, 3, 9, 8, 1, -1, -1, -1, -1, -1, -1, -1, -1, -1, -1},
      {1, 2, 10, -1, -1, -1, -1, -1, -1, -1, -1, -1, -1, -1, -1, -1},
      {0, 8, 3, 1, 2, 10, -1, -1, -1, -1, -1, -1, -1, -1, -1, -1},
      {9, 2, 10, 0, 2, 9, -1, -1, -1, -1, -1, -1, -1, -1, -1, -1},
      {2, 8, 3, 2, 10, 8, 10, 9, 8, -1, -1, -1, -1, -1, -1, -1},
      {3, 11, 2, -1, -1, -1, -1, -1, -1, -1, -1, -1, -1, -1, -1, -1},
      {0, 11, 2, 8, 11, 0, -1, -1, -1, -1, -1, -1, -1, -1, -1, -1},
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      };

    int cubeIndex = 0;  // select cube
            
    if(cornerValues[0] < isoLevel) cubeIndex = cubeIndex | 1;
    if(cornerValues[1] < isoLevel) cubeIndex = cubeIndex | 2;
    if(cornerValues[2] < isoLevel) cubeIndex = cubeIndex | 4;
    if(cornerValues[3] < isoLevel) cubeIndex = cubeIndex | 8;
    if(cornerValues[4] < isoLevel) cubeIndex = cubeIndex | 16;
    if(cornerValues[5] < isoLevel) cubeIndex = cubeIndex | 32;
    if(cornerValues[6] < isoLevel) cubeIndex = cubeIndex | 64;
    if(cornerValues[7] < isoLevel) cubeIndex = cubeIndex | 128;
          

    if (edgeTable[cubeIndex] == 0) return null;


    Point3d[] vertList = new Point3d[12];

    if (Convert.ToBoolean(edgeTable[cubeIndex] & 1)) vertList[0] = VertexInterp(isoLevel, cornerPos[0], cornerPos[1], cornerValues[0], cornerValues[1]);
    if (Convert.ToBoolean(edgeTable[cubeIndex] & 2)) vertList[1] = VertexInterp(isoLevel, cornerPos[1], cornerPos[2], cornerValues[1], cornerValues[2]);
    if (Convert.ToBoolean(edgeTable[cubeIndex] & 4)) vertList[2] = VertexInterp(isoLevel, cornerPos[2], cornerPos[3], cornerValues[2], cornerValues[3]);
    if (Convert.ToBoolean(edgeTable[cubeIndex] & 8)) vertList[3] = VertexInterp(isoLevel, cornerPos[3], cornerPos[0], cornerValues[3], cornerValues[0]);
    if (Convert.ToBoolean(edgeTable[cubeIndex] & 16)) vertList[4] = VertexInterp(isoLevel, cornerPos[4], cornerPos[5], cornerValues[4], cornerValues[5]);
    if (Convert.ToBoolean(edgeTable[cubeIndex] & 32)) vertList[5] = VertexInterp(isoLevel, cornerPos[5], cornerPos[6], cornerValues[5], cornerValues[6]);
    if (Convert.ToBoolean(edgeTable[cubeIndex] & 64)) vertList[6] = VertexInterp(isoLevel, cornerPos[6], cornerPos[7], cornerValues[6], cornerValues[7]);
    if (Convert.ToBoolean(edgeTable[cubeIndex] & 128)) vertList[7] = VertexInterp(isoLevel, cornerPos[7], cornerPos[4], cornerValues[7], cornerValues[4]);
    if (Convert.ToBoolean(edgeTable[cubeIndex] & 256)) vertList[8] = VertexInterp(isoLevel, cornerPos[0], cornerPos[4], cornerValues[0], cornerValues[4]);
    if (Convert.ToBoolean(edgeTable[cubeIndex] & 512)) vertList[9] = VertexInterp(isoLevel, cornerPos[1], cornerPos[5], cornerValues[1], cornerValues[5]);
    if (Convert.ToBoolean(edgeTable[cubeIndex] & 1024)) vertList[10] = VertexInterp(isoLevel, cornerPos[2], cornerPos[6], cornerValues[2], cornerValues[6]);
    if (Convert.ToBoolean(edgeTable[cubeIndex] & 2048)) vertList[11] = VertexInterp(isoLevel, cornerPos[3], cornerPos[7], cornerValues[3], cornerValues[7]);

    List<Mesh> triangles = new List<Mesh>();
    int k = 0;
    while (triTable[cubeIndex, k] != -1)
    {
      Mesh triangle = new Mesh();
      Point3d a = vertList[triTable[cubeIndex, k]];
      Point3d b = vertList[triTable[cubeIndex, k + 1]];
      Point3d c = vertList[triTable[cubeIndex, k + 2]];
      triangle.Vertices.Add(a);
      triangle.Vertices.Add(b);
      triangle.Vertices.Add(c);
      triangles.Add(triangle);
      k += 3;
    }
    return triangles;
  }
  
  private List<Point3d> getPointsOfOneCube(List<Vector3d> vs, int r)
  {
    List<Point3d> oneCubePts = new List<Point3d>();
    foreach (Vector3d v in vs)
    {
      Vector3d xDir = v + new Vector3d(r, 0, 0);
      Vector3d yDir = xDir + v + new Vector3d(0, r, 0);
      Vector3d zDir = xDir + v + new Vector3d(0, 0, r) + yDir + new Vector3d(0, 0, r);
      Point3d point = new Point3d(xDir + yDir + zDir);
      oneCubePts.Add(point);
    }
    return oneCubePts;
  }

  private List<Vector3d> getVectorsOfCube(int cubeDimInt)
  {
    List<Vector3d> vs = new List<Vector3d>();
    vs.Add(new Vector3d(0, 0, 0));
    vs.Add(new Vector3d(0, cubeDimInt, 0));
    vs.Add(new Vector3d(cubeDimInt, cubeDimInt, 0));
    vs.Add(new Vector3d(cubeDimInt, 0, 0));
    vs.Add(new Vector3d(0, 0, cubeDimInt));
    vs.Add(new Vector3d(0, cubeDimInt, cubeDimInt));
    vs.Add(new Vector3d(cubeDimInt, cubeDimInt, cubeDimInt));
    vs.Add(new Vector3d(cubeDimInt, 0, cubeDimInt));
    return vs;
  }
  Point3d VertexInterp(double isoLevel, Point3d p1, Point3d p2, double valP1, double valP2){
    if(Math.Abs(isoLevel - valP1) < 0.00001) return p1;
    if(Math.Abs(isoLevel - valP2) < 0.00001) return p2;
    if(Math.Abs(valP1 - valP2) < 0.00001) return p1;
    double mu = (isoLevel - valP1) / (valP2 - valP1);
    Point3d p = new Point3d(
      p1[0] + mu * (p2[0] - p1[0]),
      p1[1] + mu * (p2[1] - p1[1]),
      p1[2] + mu * (p2[2] - p1[2])
      );
    return p;
  }
# ---------- end c_script_2 ----------
srf = Surface(marchingcubes)
panel_2 = Panel(c_script_2.A)
