# Grasshopper definition starts.gh (Grasshopper 1.0.7)

crv = Curve(<curve referenced from the Rhino model>)
pop2d = Populate2D(Region={Plane=PlaneXY(0, 0, 0), Size=Domain2(u=0..20, v=0..10)}, Count=100, Seed=1)  # disabled
pop2d_2 = Populate2D(Region={Plane=PlaneXY(0, 0, 0), Size=Domain2(u=0..20, v=0..10)}, Count=100, Seed=1)  # disabled
pop2d_3 = Populate2D(Region=crv, Count=Slider(1000, range=0..1000), Seed=1)
pt = Point(pop2d)
pt_2 = Point(pop2d_2)
pt_3 = Point(pop2d_3)
c_script = CSharpScript(points=pt)  # -> out, output; inputs points: list of Point3d; disabled
# ---------- c_script: C# ----------
    //HashSet<Point3d> hSet = new HashSet<>();
    List<Curve> list = new List<Curve>();
    foreach(Point3d pt in points){
      LineCurve line = new LineCurve(pt, GetCloestPoint(points, pt));
      list.Add(line);
    }
    
    output = list;
# ---------- c_script: C# additional code ----------
  private Point3d GetCloestPoint(List<Point3d> pts, Point3d target){
    double minDis = double.MaxValue;
    Point3d output = target;
    foreach(Point3d pt in pts){
      double curDist = target.DistanceTo(pt);
      if(minDis > curDist && curDist > 0){
        minDis = target.DistanceTo(pt);
        output = pt;
      }
    }
    return output;
  }
# ---------- end c_script ----------
c_script_2 = CSharpScript(points=pt_2)  # -> out, output, A, B, C, D; inputs points: list of Point3d
# ---------- c_script_2: C# usings ----------
using Grasshopper.Kernel.Geometry;
# ---------- c_script_2: C# ----------
    //HashSet<Point3d> hSet = new HashSet<>();
    List<Curve> list = new List<Curve>();
    //foreach(Point3d pt in points){
    //  foreach(Point3d clpt in GetCloestPoint(points, pt, 2)){
    //    LineCurve line = new LineCurve(pt, clpt);
    //  }

    //  list.Add(line);
    //}
    Rhino.Geometry.Plane p = new Rhino.Geometry.Plane(new Point3d(0, 0, 0), new Vector3d(0, 1, 1));
    Mesh m = getDelaunay(points);
    //output = m.GetOutlines(p);

    List<LineCurve> lst1 = new List<LineCurve>();
    List<LineCurve> lst2 = new List<LineCurve>();
    List<LineCurve> lst3 = new List<LineCurve>();
    List<LineCurve> lst4 = new List<LineCurve>();

    bool rel = m.Faces.ConvertTrianglesToQuads(10, 0.01);
    /*
    for(int i = 0; i < m.Faces.Count; i++){
      if(m.Faces[i].IsTriangle){

        foreach(int j in m.Faces.AdjacentFaces()){
          if(m.Faces[i].ConvertTrianglesToQuads(180, 0.75))
        }

      }



    }*/


    for(int i = 0; i < m.Faces.Count; i++){
      Point3f pt1, pt2, pt3, pt4;
      m.Faces.GetFaceVertices(i, out pt1, out pt2, out pt3, out pt4);
      Point3d ct = m.Faces.GetFaceCenter(i);
      lst1.Add(new LineCurve(pt1, pt2));
      lst2.Add(new LineCurve(pt2, pt3));
      lst3.Add(new LineCurve(pt3, pt4));
      lst3.Add(new LineCurve(pt4, pt1));

      lst4.Add(new LineCurve(pt1, ct));
      lst4.Add(new LineCurve(pt2, ct));
      lst4.Add(new LineCurve(pt3, ct));
      lst4.Add(new LineCurve(pt4, ct));
    }




    output = m;
    A = lst1;
    B = lst2;
    C = lst3;
    D = lst4;
# ---------- c_script_2: C# additional code ----------
  Mesh getDelaunay(List<Point3d> pts)
  {

    //convert point3d to node2
    //grasshopper requres that nodes are saved within a Node2List for Delaunay
    var nodes = new Grasshopper.Kernel.Geometry.Node2List();
    for (int i = 0; i < pts.Count; i++)
    {
      //notice how we only read in the X and Y coordinates
      //  this is why points should be mapped onto the XY plane
      nodes.Append(new Grasshopper.Kernel.Geometry.Node2(pts[i].X, pts[i].Y));
    }

    //solve Delaunay
    var delMesh = new Mesh();
    var faces = new List<Grasshopper.Kernel.Geometry.Delaunay.Face>();

    faces = Grasshopper.Kernel.Geometry.Delaunay.Solver.Solve_Faces(nodes, 1);

    //output
    delMesh = Grasshopper.Kernel.Geometry.Delaunay.Solver.Solve_Mesh(nodes, 1, ref faces);
    return delMesh;
  }

  /*
  private PriorityQueue<Point3d> GetCloestPoint(List<Point3d> pts, Point3d target, int size){
    PriorityQueue<Point3d> pq = new PriorityQueue<Point3d>();
    Point3d output = target;
    foreach(Point3d pt in pts){
      double curDist = target.DistanceTo(pt);
      if(curDist > 0){
        pq.Push(target.DistanceTo(pt), curDist);
        if(pq.Size() > size) pq.Pop();
      }
    }
    return output;
  }



  class PriorityQueue<T>
  {
    IComparer<T> comparer;
    T[] heap;

    public int Count { get; private set; }

    public PriorityQueue() : this(null) { }
    public PriorityQueue(int capacity) : this(capacity, null) { }
    public PriorityQueue(IComparer<T> comparer) : this(16, comparer) { }

    public PriorityQueue(int capacity, IComparer<T> comparer)
    {
      this.comparer = (comparer == null) ? Comparer<T>.Default : comparer;
      this.heap = new T[capacity];
    }

    public void Push(T v)
    {
      if (Count >= heap.Length) Array.Resize(ref heap, Count * 2);
      heap[Count] = v;
      SiftUp(Count++);
    }

    public T Pop()
    {
      var v = Top();
      heap[0] = heap[--Count];
      if (Count > 0) SiftDown(0);
      return v;
    }

    public T Top()
    {
      if (Count > 0) return heap[0];
      throw new InvalidOperationException("优先队列为空");
    }

    void SiftUp(int n)
    {
      var v = heap[n];
      for (var n2 = n / 2; n > 0 && comparer.Compare(v, heap[n2]) > 0; n = n2, n2 /= 2) heap[n] = heap[n2];
      heap[n] = v;
    }

    void SiftDown(int n)
    {
      var v = heap[n];
      for (var n2 = n * 2; n2 < Count; n = n2, n2 *= 2)
      {
        if (n2 + 1 < Count && comparer.Compare(heap[n2 + 1], heap[n2]) > 0) n2++;
        if (comparer.Compare(v, heap[n2]) >= 0) break;
        heap[n] = heap[n2];
      }
      heap[n] = v;
    }
  }
  */
# ---------- end c_script_2 ----------
c_script_3 = CSharpScript(points=pt_3)  # -> out, output, A, B, C, D; inputs points: list of Point3d
# ---------- c_script_3: C# ----------
    //HashSet<Point3d> hSet = new HashSet<>();
    List<Curve> list = new List<Curve>();
    //foreach(Point3d pt in points){
    //  foreach(Point3d clpt in GetCloestPoint(points, pt, 2)){
    //    LineCurve line = new LineCurve(pt, clpt);
    //  }

    //  list.Add(line);
    //}
    Rhino.Geometry.Plane p = new Rhino.Geometry.Plane(new Point3d(0, 0, 0), new Vector3d(0, 1, 1));
    Mesh m = getDelaunay(points);
    //output = m.GetOutlines(p);

    List<LineCurve> lst1 = new List<LineCurve>();
    List<LineCurve> lst2 = new List<LineCurve>();
    List<LineCurve> lst3 = new List<LineCurve>();
    List<LineCurve> lst4 = new List<LineCurve>();

    bool rel = m.Faces.ConvertTrianglesToQuads(0, 0);
    //rel = m.Faces.ConvertTrianglesToQuads(10, 1);
    /*
    for(int i = 0; i < m.Faces.Count; i++){
      if(m.Faces[i].IsTriangle){

        foreach(int j in m.Faces.AdjacentFaces()){
          if(m.Faces[i].ConvertTrianglesToQuads(180, 0.75))
        }

      }



    }*/


    for(int i = 0; i < m.Faces.Count; i++){

      Point3f pt1, pt2, pt3, pt4;
      m.Faces.GetFaceVertices(i, out pt1, out pt2, out pt3, out pt4);
      Point3d ct = m.Faces.GetFaceCenter(i);


      if(m.Faces[i].IsTriangle){
        LineCurve lc1 = new LineCurve(pt1, pt2);
        LineCurve lc2 = new LineCurve(pt2, pt3);
        LineCurve lc3 = new LineCurve(pt3, pt1);

        lst1.Add(new LineCurve(pt1, pt2));
        lst2.Add(new LineCurve(pt2, pt3));
        lst3.Add(new LineCurve(pt3, pt1));

        lst4.Add(new LineCurve(lc1.PointAtNormalizedLength(0.5), ct));
        lst4.Add(new LineCurve(lc2.PointAtNormalizedLength(0.5), ct));
        lst4.Add(new LineCurve(lc3.PointAtNormalizedLength(0.5), ct));

      }
      else{
        LineCurve lc1 = new LineCurve(pt1, pt2);
        LineCurve lc2 = new LineCurve(pt2, pt3);
        LineCurve lc3 = new LineCurve(pt3, pt4);
        LineCurve lc4 = new LineCurve(pt4, pt1);


        lst1.Add(new LineCurve(pt1, pt2));
        lst2.Add(new LineCurve(pt2, pt3));
        lst3.Add(new LineCurve(pt3, pt4));
        lst3.Add(new LineCurve(pt4, pt1));

        lst4.Add(new LineCurve(lc1.PointAtNormalizedLength(0.5), ct));
        lst4.Add(new LineCurve(lc2.PointAtNormalizedLength(0.5), ct));
        lst4.Add(new LineCurve(lc3.PointAtNormalizedLength(0.5), ct));
        lst4.Add(new LineCurve(lc4.PointAtNormalizedLength(0.5), ct));

      }
    }
    output = m;
    A = lst1;
    B = lst2;
    C = lst3;
    D = lst4;
# ---------- c_script_3: C# additional code ----------
  Mesh getDelaunay(List<Point3d> pts)
  {

    //convert point3d to node2
    //grasshopper requres that nodes are saved within a Node2List for Delaunay
    var nodes = new Grasshopper.Kernel.Geometry.Node2List();
    for (int i = 0; i < pts.Count; i++)
    {
      //notice how we only read in the X and Y coordinates
      //  this is why points should be mapped onto the XY plane
      nodes.Append(new Grasshopper.Kernel.Geometry.Node2(pts[i].X, pts[i].Y));
    }

    //solve Delaunay
    var delMesh = new Mesh();
    var faces = new List<Grasshopper.Kernel.Geometry.Delaunay.Face>();

    faces = Grasshopper.Kernel.Geometry.Delaunay.Solver.Solve_Faces(nodes, 1);

    //output
    delMesh = Grasshopper.Kernel.Geometry.Delaunay.Solver.Solve_Mesh(nodes, 1, ref faces);
    return delMesh;
  }

  /*
  private PriorityQueue<Point3d> GetCloestPoint(List<Point3d> pts, Point3d target, int size){
    PriorityQueue<Point3d> pq = new PriorityQueue<Point3d>();
    Point3d output = target;
    foreach(Point3d pt in pts){
      double curDist = target.DistanceTo(pt);
      if(curDist > 0){
        pq.Push(target.DistanceTo(pt), curDist);
        if(pq.Size() > size) pq.Pop();
      }
    }
    return output;
  }



  class PriorityQueue<T>
  {
    IComparer<T> comparer;
    T[] heap;

    public int Count { get; private set; }

    public PriorityQueue() : this(null) { }
    public PriorityQueue(int capacity) : this(capacity, null) { }
    public PriorityQueue(IComparer<T> comparer) : this(16, comparer) { }

    public PriorityQueue(int capacity, IComparer<T> comparer)
    {
      this.comparer = (comparer == null) ? Comparer<T>.Default : comparer;
      this.heap = new T[capacity];
    }

    public void Push(T v)
    {
      if (Count >= heap.Length) Array.Resize(ref heap, Count * 2);
      heap[Count] = v;
      SiftUp(Count++);
    }

    public T Pop()
    {
      var v = Top();
      heap[0] = heap[--Count];
      if (Count > 0) SiftDown(0);
      return v;
    }

    public T Top()
    {
      if (Count > 0) return heap[0];
      throw new InvalidOperationException("优先队列为空");
    }

    void SiftUp(int n)
    {
      var v = heap[n];
      for (var n2 = n / 2; n > 0 && comparer.Compare(v, heap[n2]) > 0; n = n2, n2 /= 2) heap[n] = heap[n2];
      heap[n] = v;
    }

    void SiftDown(int n)
    {
      var v = heap[n];
      for (var n2 = n * 2; n2 < Count; n = n2, n2 *= 2)
      {
        if (n2 + 1 < Count && comparer.Compare(heap[n2 + 1], heap[n2]) > 0) n2++;
        if (comparer.Compare(v, heap[n2]) >= 0) break;
        heap[n] = heap[n2];
      }
      heap[n] = v;
    }
  }
  */
# ---------- end c_script_3 ----------
crv_2 = Curve(c_script_2.A)
crv_3 = Curve(c_script_2.B)
crv_4 = Curve(c_script_2.C)
crv_5 = Curve(c_script_3.A)
crv_6 = Curve(c_script_3.B)
crv_7 = Curve(c_script_3.C)
crv_8 = Curve(c_script_3.D)
mesh = Mesh(c_script_2.output)
mesh_2 = Mesh(c_script_3.output)
panel = Panel(c_script_3.out)
face = MeshFace()
